# Dynamo custom node FamilyInstance.GetTransform.dyf "GetTransform" (Dynamo 2.6.1.8786)
# category: Antler.Revit.Elements.FamilyInstance.Query
# Gets Transform of FamilyInstance as a Coordinate System.

family_instance = Input(family_instance: var[]..[])
python_script = Python(IN[0]=family_instance)
# ---------- python_script.python (41 lines) ----------
# Enable Python support and load DesignScript library
import clr

# Import RevitAPI
clr.AddReference("RevitAPI")
from Autodesk.Revit import DB

# For working with DesignScript abstract geometry
clr.AddReference('ProtoGeometry')
from Autodesk.DesignScript.Geometry import *

# Import ToDSType(bool) extension method
clr.AddReference("RevitNodes")
import Revit
clr.ImportExtensions(Revit.Elements)
clr.ImportExtensions(Revit.GeometryConversion)

#The inputs to this node will be stored as a list in the IN variable.
elements = IN[0]

def function(element):
	element = UnwrapElement(element)
	
	transform = element.GetTransform()
	
	coordinate_system = transform.ToCoordinateSystem()
	
	return coordinate_system	


def process(item):
	if isinstance(item, (list, tuple)):
		return [process(e) for e in item]
	else:
		try:
			return function(item)
		except:
			return


OUT = process(elements)
# ----------------------------------------
coordinate_system = Output(python_script)
