# Dynamo custom node RoomAtPoint.dyf (Dynamo 2.6.1.8786)
# category: Antler.Revit.Collect.Query
# Collects room at point. Phase is a required parameter to only collect one room.

pt = Input(pt: var[]..[])
phase = Input(phase: var[]..[])
python_script = Python(IN[0]=pt, IN[1]=phase)
# ---------- python_script.python (38 lines) ----------
# Enable Python support and load DesignScript library
import clr

# Import RevitAPI
clr.AddReference("RevitAPI")
from Autodesk.Revit import DB

# Import DocumentManager and TransactionManager
clr.AddReference ("RevitServices")
import RevitServices
from RevitServices.Persistence import DocumentManager

# Import ToDSType(bool) extension method
clr.AddReference("RevitNodes")
import Revit
clr.ImportExtensions(Revit.Elements)
clr.ImportExtensions(Revit.GeometryConversion)

#The inputs to this node will be stored as a list in the IN variables.


doc = DocumentManager.Instance.CurrentDBDocument



if isinstance(IN[0], list):
    pts = [pt.ToXyz() for pt in IN[0]]
else:
    pts = [IN[0].ToXyz()]

phase = UnwrapElement(IN[1])

if phase:
	rooms = [doc.GetRoomAtPoint(pt, phase) for pt in pts]
else:
	rooms = [doc.GetRoomAtPoint(pt) for pt in pts]	

OUT = rooms
# ----------------------------------------
room = Output(python_script)
